# Dynamo custom node Get Rhino File.dyf (Dynamo 0.7.2.24887)
# category: Archi-lab_MantisShrimp.ReadRhino
# Reads Rhino 3dm file and outputs it as an object.

File_Path = Input()
python_script = Python(IN[0]=File_Path)
# ---------- python_script.python (24 lines) ----------
#Copyright(c) 2014, Konrad Sobon
# @arch_laboratory, http://archi-lab.net

import clr
import sys
clr.AddReference('ProtoGeometry')

RhinoCommonPath = r'C:\Program Files\Rhinoceros 5 (64-bit)\System'
if RhinoCommonPath not in sys.path:
	sys.path.Add(RhinoCommonPath)
clr.AddReferenceToFileAndPath(RhinoCommonPath + r"\RhinoCommon.dll")

pyt_path = r'C:\Program Files (x86)\IronPython 2.7\Lib'
sys.path.append(pyt_path)

import Rhino as rc

#The inputs to this node will be stored as a list in the IN variable.
dataEnteringNode = IN
path = str(IN[0])

#read 3dm file
#Assign your output to the OUT variable
OUT = rc.FileIO.File3dm.Read(path)
# ----------------------------------------
Rhino_File = Output(python_script)
