# Dynamo custom node Get Rhino Layers.dyf (Dynamo 0.7.2.24887)
# category: Archi-lab_MantisShrimp.ReadRhino
# Queries Rhino file and extracts layers.

Rhino_File = Input()
python_script = Python(IN[0]=Rhino_File)
# ---------- python_script.python (28 lines) ----------
#Copyright(c) 2014, Konrad Sobon
# @arch_laboratory, http://archi-lab.net

import clr
import sys
clr.AddReference('ProtoGeometry')

RhinoCommonPath = r'C:\Program Files\Rhinoceros 5 (64-bit)\System'
if RhinoCommonPath not in sys.path:
	sys.path.Add(RhinoCommonPath)
clr.AddReferenceToFileAndPath(RhinoCommonPath + r"\RhinoCommon.dll")

pyt_path = r'C:\Program Files (x86)\IronPython 2.7\Lib'
sys.path.append(pyt_path)

import Rhino as rc

#The inputs to this node will be stored as a list in the IN variable.
dataEnteringNode = IN
rhModel = IN[0]

#extract layer names from 3dm file
rhLayers = []
for i in rhModel.Layers:
	rhLayers.append(i.Name)

#Assign your output to the OUT variable
OUT = rhLayers
# ----------------------------------------
Rhino_Layer_s = Output(python_script)  # "Rhino Layer(s)"
