# Dynamo custom node Get Rhino Mesh Face Center.dyf (Dynamo 0.7.4.3090)
# category: Archi-lab_MantisShrimp.ReadRhino
# This node will query a mesh for a face center.

Rhino_Object_s = Input()  # "Rhino Object(s)"
python_script = Python(IN[0]=Rhino_Object_s)
# ---------- python_script.python (52 lines) ----------
#Copyright(c) 2014, Konrad Sobon
# @arch_laboratory, http://archi-lab.net

import clr
import sys
clr.AddReference('ProtoGeometry')

RhinoCommonPath = r'C:\Program Files\Rhinoceros 5 (64-bit)\System'
if RhinoCommonPath not in sys.path:
	sys.path.Add(RhinoCommonPath)
clr.AddReferenceToFileAndPath(RhinoCommonPath + r"\RhinoCommon.dll")

pyt_path = r'C:\Program Files (x86)\IronPython 2.7\Lib'
sys.path.append(pyt_path)

import Rhino as rc
from Autodesk.DesignScript.Geometry import *
import math

#The inputs to this node will be stored as a list in the IN variable.
dataEnteringNode = IN
rhObjects = IN[0]

#3dPoint Conversion
def rhPoint3dToPoint(rhPoint):
	rhPointX = rhPoint.X
	rhPointY = rhPoint.Y
	rhPointZ = rhPoint.Z
	dsPoint = Point.ByCoordinates(rhPointX, rhPointY, rhPointZ)
	return dsPoint

#convert rhino/gh geometry to ds geometry
dsMeshes = []
values = []
points = []
for i in rhObjects:
	try:
		i = i.Geometry
	except:
		pass
	if i.ToString() == "Rhino.Geometry.Mesh":
		faces = i.Faces
		for i in range(0, faces.Count, 1):
			points.append(rhPoint3dToPoint(faces.GetFaceCenter(i)))
	else:
		message = "Please provide Mesh to extract \nFace Center points."

#Assign your output to the OUT variable
if len(points) == 0:
	OUT = '\n'.join('{:^35}'.format(s) for s in message.split('\n'))
else:
	OUT = points
# ----------------------------------------
Face_Center_s = Output(python_script)  # "Face Center(s)"
