# Dynamo custom node Get Rhino Object GUID.dyf (Dynamo 0.7.2.24887)
# category: Archi-lab_MantisShrimp.ReadRhino
# Queries Rhino object for its GUID.

Rhino_Object_s = Input()  # "Rhino Object(s)"
python_script = Python(IN[0]=Rhino_Object_s)
# ---------- python_script.python (28 lines) ----------
#Copyright(c) 2014, Konrad Sobon
# @arch_laboratory, http://archi-lab.net

import clr
import sys
clr.AddReference('ProtoGeometry')

RhinoCommonPath = r'C:\Program Files\Rhinoceros 5 (64-bit)\System'
if RhinoCommonPath not in sys.path:
	sys.path.Add(RhinoCommonPath)
clr.AddReferenceToFileAndPath(RhinoCommonPath + r"\RhinoCommon.dll")

pyt_path = r'C:\Program Files (x86)\IronPython 2.7\Lib'
sys.path.append(pyt_path)

import Rhino as rc

#The inputs to this node will be stored as a list in the IN variable.
dataEnteringNode = IN
rhObjects = IN[0]

#get object guid
rhGUID = []
for i in rhObjects:
	rhGUID.append(i.Attributes.ObjectId)
	
#Assign your output to the OUT variable
OUT = rhGUID
# ----------------------------------------
GUID_s = Output(python_script)  # "GUID(s)"
