# Dynamo custom node Get Rhino Object Keys.dyf (Dynamo 0.7.4.3090)
# category: Archi-lab_MantisShrimp.ReadRhino.Properties
# This node will extract all "keys" from the User Strings key/value combination. Use this node in combination with Get Rhino Object User Strings to get user string values.

Rhino_Object_s = Input()  # "Rhino Object(s)"
python_script = Python(IN[0]=Rhino_Object_s)
# ---------- python_script.python (33 lines) ----------
#Copyright(c) 2014, Konrad Sobon
# @arch_laboratory, http://archi-lab.net

import clr
import sys
clr.AddReference('ProtoGeometry')

RhinoCommonPath = r'C:\Program Files\Rhinoceros 5 (64-bit)\System'
if RhinoCommonPath not in sys.path:
	sys.path.Add(RhinoCommonPath)
clr.AddReferenceToFileAndPath(RhinoCommonPath + r"\RhinoCommon.dll")

pyt_path = r'C:\Program Files (x86)\IronPython 2.7\Lib'
sys.path.append(pyt_path)

import Rhino as rc
from Autodesk.DesignScript.Geometry import *
import math

#The inputs to this node will be stored as a list in the IN variable.
dataEnteringNode = IN
rhObjects = IN[0]
userStringKeys = []
#convert rhino/gh geometry to ds geometry
for item in rhObjects:
	try:
		item = item.Geometry
	except:
		pass
	userStringKeys.append(item.GetUserStrings().Keys)

#Assign your output to the OUT variable
OUT = userStringKeys
# ----------------------------------------
Keys = Output(python_script)
