# Dynamo custom node RH Arc to DS Arc.dyf (Dynamo 0.7.2.24887)
# category: Archi-lab_MantisShrimp.ReadRhino
# Converts Rhino arcs to Design Script arcs.

Rhino_Object_s = Input()  # "Rhino Object(s)"
python_script = Python(IN[0]=Rhino_Object_s)
# ---------- python_script.python (65 lines) ----------
#Copyright(c) 2014, Konrad Sobon
# @arch_laboratory, http://archi-lab.net

import clr
import sys
clr.AddReference('ProtoGeometry')

RhinoCommonPath = r'C:\Program Files\Rhinoceros 5 (64-bit)\System'
if RhinoCommonPath not in sys.path:
	sys.path.Add(RhinoCommonPath)
clr.AddReferenceToFileAndPath(RhinoCommonPath + r"\RhinoCommon.dll")

pyt_path = r'C:\Program Files (x86)\IronPython 2.7\Lib'
sys.path.append(pyt_path)

from Autodesk.DesignScript.Geometry import *
import Rhino as rc

#The inputs to this node will be stored as a list in the IN variable.
dataEnteringNode = IN
rhObjects = IN[0]

#Vector3d conversion function
def rhVector3dToVector(rhVector):
	VectorX = rhVector.X 
	VectorY = rhVector.Y
	VectorZ = rhVector.Z
	dsVector = Vector.ByCoordinates(VectorX, VectorY, VectorZ)
	return dsVector

#3dPoint Conversion
def rhPoint3dToPoint(rhPoint):
	rhPointX = rhPoint.X
	rhPointY = rhPoint.Y
	rhPointZ = rhPoint.Z
	dsPoint = Point.ByCoordinates(rhPointX, rhPointY, rhPointZ)
	return dsPoint
	
#Plane conversion function
def rhPlaneToPlane(rhPlane):
	normal = rhVector3dToVector(rhPlane.Normal)
	origin = rhPoint3dToPoint(rhPlane.Origin)
	dsPlane = Plane.ByOriginNormal(origin, normal)
	return dsPlane

#arc conversion function
def rhArcToArc(rhArc):
	dsStartPoint = rhPoint3dToPoint(rhArc.Arc.StartPoint)
	dsEndPoint = rhPoint3dToPoint(rhArc.Arc.EndPoint)
	dsCenter = rhPoint3dToPoint(rhArc.Arc.Center)
	dsArc = Arc.ByCenterPointStartPointEndPoint(dsCenter, dsStartPoint, dsEndPoint)
	return dsArc

#convert rhino/gh geometry to ds geometry
dsArcs = []
for i in rhObjects:
	try:
		i = i.Geometry
	except:
		pass
	if i.ToString() == "Rhino.Geometry.ArcCurve" and i.IsArc():
		dsArcs.append(rhArcToArc(i))

#Assign your output to the OUT variable
OUT = dsArcs
# ----------------------------------------
Arc_s = Output(python_script)  # "Arc(s)"
