# Dynamo custom node RH Line to DS Line.dyf (Dynamo 0.7.2.24887)
# category: Archi-lab_MantisShrimp.ReadRhino
# Converts Rhino Lines to Design Script Lines

Rhino_Object_s = Input()  # "Rhino Object(s)"
python_script = Python(IN[0]=Rhino_Object_s)
# ---------- python_script.python (51 lines) ----------
#Copyright(c) 2014, Konrad Sobon
# @arch_laboratory, http://archi-lab.net

import clr
import sys
clr.AddReference('ProtoGeometry')

RhinoCommonPath = r'C:\Program Files\Rhinoceros 5 (64-bit)\System'
if RhinoCommonPath not in sys.path:
	sys.path.Add(RhinoCommonPath)
clr.AddReferenceToFileAndPath(RhinoCommonPath + r"\RhinoCommon.dll")

pyt_path = r'C:\Program Files (x86)\IronPython 2.7\Lib'
sys.path.append(pyt_path)

import Rhino as rc
from Autodesk.DesignScript.Geometry import *

#The inputs to this node will be stored as a list in the IN variable.
dataEnteringNode = IN
rhObjects = IN[0]

#3dPoint Conversion function
def rhPoint3dToPoint(rhPoint):
	rhPointX = rhPoint.X
	rhPointY = rhPoint.Y
	rhPointZ = rhPoint.Z
	dsPoint = Point.ByCoordinates(rhPointX, rhPointY, rhPointZ)
	return dsPoint

#LineCurve conversion function
def rhLineToLine(rhCurve):
	rhStartPoint = rhCurve.PointAtStart
	dsStartPoint = rhPoint3dToPoint(rhStartPoint)
	rhEndPoint = rhCurve.PointAtEnd
	dsEndPoint = rhPoint3dToPoint(rhEndPoint)
	dsLine = Line.ByStartPointEndPoint(dsStartPoint, dsEndPoint)
	return dsLine

#convert rhino/gh geometry to ds geometry
dsLines = []
for i in rhObjects:
	try:
		i = i.Geometry
	except:
		pass
	if i.ToString() == "Rhino.Geometry.LineCurve":
		dsLines.append(rhLineToLine(i))

#Assign your output to the OUT variable
OUT = dsLines
# ----------------------------------------
Line_s = Output(python_script)  # "Line(s)"
