# Dynamo custom node RH Polyline to DS Polycurve.dyf (Dynamo 0.7.2.24887)
# category: Archi-lab_MantisShrimp.ReadRhino
# Converts Rhino polyline curve to Design Script polycurve.

Rhino_Object_s = Input()  # "Rhino Object(s)"
python_script = Python(IN[0]=Rhino_Object_s)
# ---------- python_script.python (53 lines) ----------
#Copyright(c) 2014, Konrad Sobon
# @arch_laboratory, http://archi-lab.net

import clr
import sys
clr.AddReference('ProtoGeometry')

RhinoCommonPath = r'C:\Program Files\Rhinoceros 5 (64-bit)\System'
if RhinoCommonPath not in sys.path:
	sys.path.Add(RhinoCommonPath)
clr.AddReferenceToFileAndPath(RhinoCommonPath + r"\RhinoCommon.dll")

pyt_path = r'C:\Program Files (x86)\IronPython 2.7\Lib'
sys.path.append(pyt_path)

from Autodesk.DesignScript.Geometry import *
import Rhino as rc

#The inputs to this node will be stored as a list in the IN variable.
dataEnteringNode = IN
rhObjects = IN[0]

#3dPoint Conversion
def rhPoint3dToPoint(rhPoint):
	rhPointX = rhPoint.X
	rhPointY = rhPoint.Y
	rhPointZ = rhPoint.Z
	dsPoint = Point.ByCoordinates(rhPointX, rhPointY, rhPointZ)
	return dsPoint

#poly curve conversion function
def rhCurveToPolyCurve(rhCurve):
	ptArray = []
	pCount = rhCurve.PointCount
	for i in range(0, pCount):
		dsPoint = rhPoint3dToPoint(rhCurve.Point(i))
		ptArray.append(dsPoint)
	dsPolyCurve = PolyCurve.ByPoints(ptArray)
	del ptArray[:]
	return dsPolyCurve

#convert rhino/gh geometry to ds geometry
dsPolyCurves = []
for i in rhObjects:
	try:
		i = i.Geometry
	except:
		pass
	if i.ToString() == "Rhino.Geometry.PolylineCurve":
		dsPolyCurves.append(rhCurveToPolyCurve(i))

#Assign your output to the OUT variable
OUT = dsPolyCurves
# ----------------------------------------
PolyCurve_s = Output(python_script)  # "PolyCurve(s)"
